# Grasshopper definition Slice.ghx (Grasshopper 1.0.7)

panel = Panel("積層高さは、0.027mm で良い")
panel_2 = Panel("C:\Users\ysoky\Documents\Digital_Artisan\Stratasys_Print_Prepare")
panel_3 = Panel("1")
mesh = Mesh(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)
brep = Brep(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)
panel_4 = Panel("""300 dpi
450 px = 1.5 inch = 38.1 mm""")
python = GhPythonScript(x=panel_2)  # -> out
# ---------- python: Python ----------
import sys

sys.path.append(x)
print(sys.path)
# ---------- end python ----------
merge = Merge(Data1=mesh, Data2=brep)
panel_5 = Panel(python)
python_2 = GhPythonScript(BOOL=Button(), WHD="38.1", LAYER_HEIGHT="0.027", TARGET_GEOMETRY=merge, GEOMETRY_INDEX="0")  # -> out, slice_count, OUTPUT; inputs TARGET_GEOMETRY: list
# ---------- python_2: Python ----------
import Rhino
import Rhino.Geometry as rg
import rhinoscriptsyntax as rs
import scriptcontext as sc


import prepare_operate_geometry
reload(prepare_operate_geometry)


bg = prepare_operate_geometry.Bake_Geometry()
cg = prepare_operate_geometry.Create_Geometry()
cmd = prepare_operate_geometry.rs_Command()
sg = prepare_operate_geometry.Slice_Geometry()
ut = prepare_operate_geometry.Util()


# print(dir(prepare_operate_geometry))
# print(dir(sg))


##############################


size_ = float(WHD)
layer_ = float(LAYER_HEIGHT)
slice_count = int(size_ / layer_)
index = int(GEOMETRY_INDEX)
geos = TARGET_GEOMETRY
dir_path = "C:\\Users\\ysoky\\Documents\\Digital_Artisan\\Stratasys_Print_Prepare\\images\\"


a = cg.create_box(size_)
print(int(size_ / layer_) + 1)



if BOOL:
    OUTPUT = sg.slicing(ghdoc, dir_path, geos, index, layer_, size_)
# ---------- end python_2 ----------
panel_6 = Panel(python_2.out)
python_3 = GhPythonScript(SIZE="38.1", BOOL=Button(), PREVIEW=Toggle(False))  # -> a
# ---------- python_3: Python ----------
import Rhino
import Rhino.Geometry as rg
import rhinoscriptsyntax as rs
import scriptcontext as sc

import prepare_operate_geometry
reload(prepare_operate_geometry)

bg = prepare_operate_geometry.Bake_Geometry()
cg = prepare_operate_geometry.Create_Geometry()
cmd = prepare_operate_geometry.rs_Command()
sg = prepare_operate_geometry.Slice_Geometry()
ut = prepare_operate_geometry.Util()


dir_path = "C:\\Users\\ysoky\\Documents\\Digital_Artisan\\Stratasys_Print_Prepare\\images\\"
size_name = dir_path + "size\\size.png"

print(size_name)

rect_ = cg.create_rect(SIZE)
pic_size = 1000


if PREVIEW:
    
    a = rect_ 


if BOOL:
    
    bg.bake_breps(ghdoc, rect_)
    cmd.capture_image_size_w_all_option(size_name, pic_size, pic_size)
# ---------- end python_3 ----------
panel_7 = Panel(python_2.OUTPUT)
panel_8 = Panel(python_3)
